# Grasshopper definition Main Puzzle Piece.gh (Grasshopper 1.0.7)

rectangle = Rectangle(Plane=PlaneXY(0, 0, 0), XSize=Slider(0.978, range=0..10), YSize=Slider(0.165, range=0..10), Radius=0)  # -> Rectangle, Length
vector_xyz = VectorXYZ(XComponent=Slider(0.489, range=0..10), YComponent=Slider(0, range=0..10), ZComponent=0)  # -> Vector, Length
move = Move(Geometry=rectangle.Rectangle, Motion=vector_xyz.Vector)  # -> Geometry, Transform
subtraction = Subtraction(A=Slider(0.165, range=0..10), B=move.Geometry)
parameter = Rectangle(Plane=PlaneXY(0, 0, 0), XSize=Slider(2.563, range=0..10), YSize=Slider(2, range=0..10), Radius=0)  # -> Rectangle, Length
rectangular_array = RectangularArray(Geometry=move.Geometry, Cell=parameter.Rectangle, XCount=Slider(1, range=0..10), YCount=Slider(2, range=0..10))  # -> Geometry, Transform
region_difference = RegionDifference(CurvesA=parameter.Rectangle, CurvesB=rectangular_array.Geometry)
