# Grasshopper definition Puzzle Box.gh (Grasshopper 1.0.7)

rectangle = Rectangle(Plane=PlaneXY(0, 0, 0), XSize=Slider(0.978, range=0..10), YSize=Slider(0.165, range=0..10), Radius=0)  # -> Rectangle, Length
vector_xyz = VectorXYZ(XComponent=Slider(0.489, range=0..10), YComponent=Slider(0, range=0..10), ZComponent=0)  # -> Vector, Length
parameter = Rectangle(Plane=PlaneXY(0, 0, 0), XSize=Slider(1.975, range=0..10), YSize=Slider(1.75, range=0..10), Radius=0)  # -> Rectangle, Length
polar_array = PolarArray(Plane=PlaneXY(0, 0, 0), Count=10, Angle=6.283185307)  # -> Geometry, Transform
vector_xyz_2 = VectorXYZ(XComponent=Slider(0.489, range=0..10), YComponent=Slider(1.585, range=0..10), ZComponent=0)  # -> Vector, Length
move = Move(Geometry=rectangle.Rectangle, Motion=vector_xyz.Vector)  # -> Geometry, Transform
number_slider = Slider(2, range=0..10)
integer = Integer(5)
move_2 = Move(Geometry=rectangle.Rectangle, Motion=vector_xyz_2.Vector)  # -> Geometry, Transform
rectangular_array = RectangularArray(
    Geometry=move.Geometry,
    Cell={Plane=PlaneXY(0, 0, 0), Size=Domain2(u=0..10, v=0..5)},
    XCount=Slider(0, range=0..10),
    YCount=Slider(2, range=0..10))  # -> Geometry, Transform
polar_array_2 = PolarArray(Plane=PlaneXY(0, 0, 0), Count=10, Angle=6.283185307)  # -> Geometry, Transform
addition = Addition()
null_item = NullItem()  # -> NullFlags, InvalidFlags, Description
