# Grasshopper definition Male Puzzle Piece v3.gh (Grasshopper 1.0.7)

control_knob = ControlKnob(Decimals=3, Limit=True, Maximum=10, Minimum=0, Range=1, Value=10)
rotate = Rotate(Angle=control_knob, Plane=PlaneXY(0, 0, 0))  # -> Geometry, Transform

parameter = Rectangle(Plane=PlaneXY(0, 0, 0), XSize=Slider(1.975, range=0..10), YSize=Slider(1.75, range=0..10), Radius=0)  # -> Rectangle, Length; disabled
md_slider = MDSlider(SliderMode=0, slider_value=Point(0.5, 0.5, 0.5), x_domain=Domain(0, 1), y_domain=Domain(0, 1), z_domain=Domain(0, 1))

rectangle = Rectangle(Plane=PlaneXY(0, 0, 0), XSize=Slider(1, range=0..10), YSize=Slider(0.2, range=0..10), Radius=0)  # -> Rectangle, Length
vector_xyz = VectorXYZ(XComponent=Slider(1, range=0..10), YComponent=Slider(10, range=-10..10), ZComponent=0)  # -> Vector, Length
move = Move(Geometry=rectangle.Rectangle, Motion=vector_xyz.Vector)  # -> Geometry, Transform

rotate_2 = Rotate(Geometry=move.Geometry, Angle=Slider(0, range=0..10), Plane=PlaneXY(0, 0, 0))  # -> Geometry, Transform
parameter_2 = Rectangle(Plane=PlaneXY(0, 0, 0), XSize=Slider(3, range=0..10), YSize=Slider(2, range=0..10), Radius=0)  # -> Rectangle, Length
region_difference = RegionDifference(CurvesA=parameter_2.Rectangle, CurvesB=rotate_2.Geometry)
vector_xyz_2 = VectorXYZ(XComponent=Slider(6, range=0..10), YComponent=Slider(0, range=0..10), ZComponent=0)  # -> Vector, Length
move_2 = Move(Geometry=region_difference, Motion=vector_xyz_2.Vector)  # -> Geometry, Transform

rectangle_2 = Rectangle(Plane=PlaneXY(0, 0, 0), XSize=Slider(1, range=0..10), YSize=Slider(0.2, range=0..10), Radius=0)  # -> Rectangle, Length
vector_xyz_3 = VectorXYZ(XComponent=Slider(16, range=0..20), YComponent=Slider(2, range=0..10), ZComponent=0)  # -> Vector, Length
move_3 = Move(Geometry=rectangle_2.Rectangle, Motion=vector_xyz_3.Vector)  # -> Geometry, Transform

parameter_3 = Rectangle(Plane=PlaneXY(0, 0, 0), XSize=Slider(3, range=0..10), YSize=Slider(2, range=0..10), Radius=0)  # -> Rectangle, Length
rotate_3 = Rotate(Angle=Slider(0, range=0..10), Plane=PlaneXY(0, 0, 0))  # -> Geometry, Transform
region_difference_2 = RegionDifference(CurvesA=move_2.Geometry, CurvesB=move_3.Geometry)
vector_xyz_4 = VectorXYZ(XComponent=Slider(4, range=0..10), YComponent=Slider(0, range=0..10), ZComponent=0)  # -> Vector, Length
move_4 = Move(Geometry=region_difference_2, Motion=vector_xyz_4.Vector)  # -> Geometry, Transform

rectangle_3 = Rectangle(Plane=PlaneXY(0, 0, 0), XSize=Slider(0.2, range=0..10), YSize=Slider(1, range=0..10), Radius=0)  # -> Rectangle, Length
vector_xyz_5 = VectorXYZ(XComponent=Slider(10, range=0..10), YComponent=Slider(0.5, range=-10..10.001), ZComponent=0)  # -> Vector, Length
move_5 = Move(Geometry=rectangle_3.Rectangle, Motion=vector_xyz_5.Vector)  # -> Geometry, Transform

region_difference_3 = RegionDifference(CurvesA=move_4.Geometry, CurvesB=move_5.Geometry)
vector_xyz_6 = VectorXYZ(XComponent=Slider(5, range=0..10), YComponent=Slider(0, range=0..10), ZComponent=0)  # -> Vector, Length
move_6 = Move(Geometry=region_difference_3, Motion=vector_xyz_6.Vector)  # -> Geometry, Transform

rectangle_4 = Rectangle(Plane=PlaneXY(0, 0, 0), XSize=Slider(1, range=0..10), YSize=Slider(0.2, range=0..10), Radius=0)  # -> Rectangle, Length
vector_xyz_7 = VectorXYZ(XComponent=Slider(16, range=0..30), YComponent=Slider(-0.2, range=-10..10), ZComponent=0)  # -> Vector, Length
move_7 = Move(Geometry=rectangle_4.Rectangle, Motion=vector_xyz_7.Vector)  # -> Geometry, Transform

rectangle_5 = Rectangle(Plane=PlaneXY(0, 0, 0), XSize=Slider(0.2, range=0..10), YSize=Slider(1, range=0..10), Radius=0)  # -> Rectangle, Length
vector_xyz_8 = VectorXYZ(XComponent=Slider(18, range=0..20), YComponent=Slider(0.5, range=-10..10.001), ZComponent=0)  # -> Vector, Length
move_8 = Move(Geometry=rectangle_5.Rectangle, Motion=vector_xyz_8.Vector)  # -> Geometry, Transform

merge = Merge(Data1=move_8.Geometry)
region_union = RegionUnion(Curves=merge)

vector_xyz_9 = VectorXYZ(XComponent=Slider(5, range=0..10), YComponent=Slider(0, range=0..10), ZComponent=0)  # -> Vector, Length
move_9 = Move(Geometry=region_union, Motion=vector_xyz_9.Vector)  # -> Geometry, Transform

merge_2 = Merge(Data1=move_6.Geometry, Data2=move_3.Geometry, Data3=move_8.Geometry, Data4=move_7.Geometry)
